test file "NBMS_APP_Testfile"
  coverage: Decision, MCDC, Condition

suite "New Test Suite 1"

  case "New Test Case 1" [baseline]
    model NBMS_App, harness NBMS_App_Harness
    baseline "Iteration1.mat"
      sm_BMSMODE
      Prechg_Mosfet_cmd
      HV_Mosfet_cmd
      DCDC_Mosfet_cmd
      Prechg_Mosfet
      HV_Mosfet
      DCDC_Mosfet
      ASC_Prep_Flag
      Chrgr_Prep_Flag
      Prechg_Volt_Flt
      MaxTemp
    baseline "Iteration2.mat"
      sm_BMSMODE
      Prechg_Mosfet_cmd
      HV_Mosfet_cmd
      DCDC_Mosfet_cmd
      Prechg_Mosfet
      HV_Mosfet
      DCDC_Mosfet
      ASC_Prep_Flag
      Chrgr_Prep_Flag
      Prechg_Volt_Flt
      MaxTemp
    baseline "Iteration3.mat"
      sm_BMSMODE
      Prechg_Mosfet_cmd
      HV_Mosfet_cmd
      DCDC_Mosfet_cmd
      Prechg_Mosfet
      HV_Mosfet
      DCDC_Mosfet
      ASC_Prep_Flag
      Chrgr_Prep_Flag
      Prechg_Volt_Flt
      MaxTemp
    baseline "Iteration4.mat"
      sm_BMSMODE
      Prechg_Mosfet_cmd
      HV_Mosfet_cmd
      DCDC_Mosfet_cmd
      Prechg_Mosfet
      HV_Mosfet
      DCDC_Mosfet
      ASC_Prep_Flag
      Chrgr_Prep_Flag
      Prechg_Volt_Flt
      MaxTemp
    baseline "Iteration5.mat"
      sm_BMSMODE
      Prechg_Mosfet_cmd
      HV_Mosfet_cmd
      DCDC_Mosfet_cmd
      Prechg_Mosfet
      HV_Mosfet
      DCDC_Mosfet
      ASC_Prep_Flag
      Chrgr_Prep_Flag
      Prechg_Volt_Flt
      MaxTemp
    baseline "Iteration6.mat"
      sm_BMSMODE
      Prechg_Mosfet_cmd
      HV_Mosfet_cmd
      DCDC_Mosfet_cmd
      Prechg_Mosfet
      HV_Mosfet
      DCDC_Mosfet
      ASC_Prep_Flag
      Chrgr_Prep_Flag
      Prechg_Volt_Flt
      MaxTemp
    baseline "Iteration7.mat"
      sm_BMSMODE
      Prechg_Mosfet_cmd
      HV_Mosfet_cmd
      DCDC_Mosfet_cmd
      Prechg_Mosfet
      HV_Mosfet
      DCDC_Mosfet
      ASC_Prep_Flag
      Chrgr_Prep_Flag
      Prechg_Volt_Flt
      MaxTemp
    baseline "Iteration8.mat"
      sm_BMSMODE
      Prechg_Mosfet_cmd
      HV_Mosfet_cmd
      DCDC_Mosfet_cmd
      Prechg_Mosfet
      HV_Mosfet
      DCDC_Mosfet
      ASC_Prep_Flag
      Chrgr_Prep_Flag
      Prechg_Volt_Flt
      MaxTemp
    baseline "Iteration9.mat"
      sm_BMSMODE
      Prechg_Mosfet_cmd
      HV_Mosfet_cmd
      DCDC_Mosfet_cmd
      Prechg_Mosfet
      HV_Mosfet
      DCDC_Mosfet
      ASC_Prep_Flag
      Chrgr_Prep_Flag
      Prechg_Volt_Flt
      MaxTemp
    baseline "Iteration10.mat"
      sm_BMSMODE
      Prechg_Mosfet_cmd
      HV_Mosfet_cmd
      DCDC_Mosfet_cmd
      Prechg_Mosfet
      HV_Mosfet
      DCDC_Mosfet
      ASC_Prep_Flag
      Chrgr_Prep_Flag
      Prechg_Volt_Flt
      MaxTemp
    baseline "Iteration11.mat"
      sm_BMSMODE
      Prechg_Mosfet_cmd
      HV_Mosfet_cmd
      DCDC_Mosfet_cmd
      Prechg_Mosfet
      HV_Mosfet
      DCDC_Mosfet
      ASC_Prep_Flag
      Chrgr_Prep_Flag
      Prechg_Volt_Flt
      MaxTemp
    baseline "Iteration12.mat"
      sm_BMSMODE
      Prechg_Mosfet_cmd
      HV_Mosfet_cmd
      DCDC_Mosfet_cmd
      Prechg_Mosfet
      HV_Mosfet
      DCDC_Mosfet
      ASC_Prep_Flag
      Chrgr_Prep_Flag
      Prechg_Volt_Flt
      MaxTemp
    baseline "Iteration13.mat"
      sm_BMSMODE
      Prechg_Mosfet_cmd
      HV_Mosfet_cmd
      DCDC_Mosfet_cmd
      Prechg_Mosfet
      HV_Mosfet
      DCDC_Mosfet
      ASC_Prep_Flag
      Chrgr_Prep_Flag
      Prechg_Volt_Flt
      MaxTemp
    baseline "Iteration14.mat"
      sm_BMSMODE
      Prechg_Mosfet_cmd
      HV_Mosfet_cmd
      DCDC_Mosfet_cmd
      Prechg_Mosfet
      HV_Mosfet
      DCDC_Mosfet
      ASC_Prep_Flag
      Chrgr_Prep_Flag
      Prechg_Volt_Flt
      MaxTemp
    baseline "Iteration15.mat"
      sm_BMSMODE
      Prechg_Mosfet_cmd
      HV_Mosfet_cmd
      DCDC_Mosfet_cmd
      Prechg_Mosfet
      HV_Mosfet
      DCDC_Mosfet
      ASC_Prep_Flag
      Chrgr_Prep_Flag
      Prechg_Volt_Flt
      MaxTemp
    baseline "Iteration16.mat"
      sm_BMSMODE
      Prechg_Mosfet_cmd
      HV_Mosfet_cmd
      DCDC_Mosfet_cmd
      Prechg_Mosfet
      HV_Mosfet
      DCDC_Mosfet
      ASC_Prep_Flag
      Chrgr_Prep_Flag
      Prechg_Volt_Flt
      MaxTemp
    baseline "Iteration17.mat"
      sm_BMSMODE
      Prechg_Mosfet_cmd
      HV_Mosfet_cmd
      DCDC_Mosfet_cmd
      Prechg_Mosfet
      HV_Mosfet
      DCDC_Mosfet
      ASC_Prep_Flag
      Chrgr_Prep_Flag
      Prechg_Volt_Flt
      MaxTemp
    baseline "Iteration18.mat"
      sm_BMSMODE
      Prechg_Mosfet_cmd
      HV_Mosfet_cmd
      DCDC_Mosfet_cmd
      Prechg_Mosfet
      HV_Mosfet
      DCDC_Mosfet
      ASC_Prep_Flag
      Chrgr_Prep_Flag
      Prechg_Volt_Flt
      MaxTemp
    baseline "Iteration19.mat"
      sm_BMSMODE
      Prechg_Mosfet_cmd
      HV_Mosfet_cmd
      DCDC_Mosfet_cmd
      Prechg_Mosfet
      HV_Mosfet
      DCDC_Mosfet
      ASC_Prep_Flag
      Chrgr_Prep_Flag
      Prechg_Volt_Flt
      MaxTemp
    baseline "Iteration20.mat"
      sm_BMSMODE
      Prechg_Mosfet_cmd
      HV_Mosfet_cmd
      DCDC_Mosfet_cmd
      Prechg_Mosfet
      HV_Mosfet
      DCDC_Mosfet
      ASC_Prep_Flag
      Chrgr_Prep_Flag
      Prechg_Volt_Flt
      MaxTemp
    baseline "Iteration21.mat"
      sm_BMSMODE
      Prechg_Mosfet_cmd
      HV_Mosfet_cmd
      DCDC_Mosfet_cmd
      Prechg_Mosfet
      HV_Mosfet
      DCDC_Mosfet
      ASC_Prep_Flag
      Chrgr_Prep_Flag
      Prechg_Volt_Flt
      MaxTemp
    baseline "Iteration22.mat" (0 of 11 signals compared)
    baseline "Iteration23.mat"
      sm_BMSMODE
      Prechg_Mosfet_cmd
      HV_Mosfet_cmd
      DCDC_Mosfet_cmd
      Prechg_Mosfet
      HV_Mosfet
      DCDC_Mosfet
      ASC_Prep_Flag
      Chrgr_Prep_Flag
      Prechg_Volt_Flt
      MaxTemp
    iterations:
      Iteration1: TestSequenceScenario "ChargeWhenIgOn", Baseline "Iteration1.mat"
      Iteration2: TestSequenceScenario "DischgWhenIgOn", Baseline "Iteration2.mat"
      Iteration3: TestSequenceScenario "ChargeWhenIgOff", Baseline "Iteration3.mat"
      Iteration4: TestSequenceScenario "ChgToDIschgIgOn", Baseline "Iteration4.mat"
      Iteration5: TestSequenceScenario "SleepToStandby", Baseline "Iteration5.mat"
      Iteration6: TestSequenceScenario "DischgToStandby", Baseline "Iteration6.mat"
      Iteration7: TestSequenceScenario "StandbyToDischgIgOn", Baseline "Iteration7.mat"
      Iteration8: TestSequenceScenario "IgOffToOnInCharge", Baseline "Iteration8.mat"
      Iteration9: TestSequenceScenario "IgOnToOffInCharge", Baseline "Iteration9.mat"
      Iteration10: TestSequenceScenario "VehPoweredOff", Baseline "Iteration10.mat"
      Iteration11: TestSequenceScenario "G4T1DischgFlt", Baseline "Iteration11.mat"
      Iteration12: TestSequenceScenario "G4T2DischgFlt", Baseline "Iteration12.mat"
      Iteration13: TestSequenceScenario "G4CommonFlt", Baseline "Iteration13.mat"
      Iteration14: TestSequenceScenario "G4ChargeFlt", Baseline "Iteration14.mat"
      Iteration15: TestSequenceScenario "DischgToChgIgOn", Baseline "Iteration15.mat"
      Iteration16: TestSequenceScenario "FaultToSleep", Baseline "Iteration16.mat"
      Iteration17: TestSequenceScenario "ChgToStandbyIgOn", Baseline "Iteration17.mat"
      Iteration18: TestSequenceScenario "ChgToStandbyIgOff", Baseline "Iteration18.mat"
      Iteration19: TestSequenceScenario "StandbyToChargeIgOn", Baseline "Iteration19.mat"
      Iteration20: TestSequenceScenario "StandbyToChargeIgOff", Baseline "Iteration20.mat"
      Iteration21: TestSequenceScenario "ChgToFltIgOff", Baseline "Iteration21.mat"
      Iteration22: TestSequenceScenario "FltToChgIgOff", Baseline "Iteration22.mat"
      Iteration23: TestSequenceScenario "FltToChgIgOn", Baseline "Iteration23.mat"